# Grasshopper definition convert_building_physics.gh (Grasshopper 0.9.76)
# plug-ins: Python Interpreter, FalseStartToggle

# ---- group: sets time steps for simulation
start_month = Panel("2")
start_day = Panel("1")
number_of_hours = Panel("138")
doy_hoy = Ladybug_DOY_HOY(days=start_day, months=start_month, hours=1)  # -> HOY, DOY, date; plug-in component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
series = Series(Start=0, Step=1, Count=number_of_hours)
addition = Addition(A=doy_hoy.HOY, B=series)
int = Integer(addition)

# ----
# Draw a room with windows
panel = Panel("4.9")
# Get temperatures and calculate radiation using ladybug
outward_facing_surfaces = Panel("0")

ladybug = Ladybug_Ladybug()  # -> Vviiiiiiiiiizzz; plug-in component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
open_weather_file = Ladybug_OpenEPWWeatherFile(open=Toggle(True))  # -> epwFile; plug-in component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

box = DomainBox(Base=PlaneXY(0, 0, 0), X=panel, Y="7", Z="3.1")
number_slider = Slider(5415, range=0..8000)

# ----
# RC building simulation
emissionsystems = EmissionSystems()  # -> out; plug-in component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
supplysystems = SupplySystems()  # -> out; plug-in component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
modularbuildingphysics = ModularBuildingPhysics()  # -> out; plug-in component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

debrep = DeconstructBrep(Brep=box)  # -> Faces, Edges, Vertices
item = ListItem(List=debrep.Faces, Index=outward_facing_surfaces, Wrap=True)

# ---- group: display
cull_i = CullIndex(List=debrep.Faces, Indices=outward_facing_surfaces, Wrap=True)
cluster = Cluster(G=debrep.Faces, L=debrep.Faces)  # -> orientedtocam, int_2
tag = TextTag3D(Location=cluster.orientedtocam, Text=cluster.int_2, Size=0.4, Justification=7)

# ----
addition_2 = Addition(A=number_slider, B=Slider(-5, range=-5..5))
window_wall_ratio = Slider(0.9, range=0..1)
edges = BrepEdges(Brep=item)  # -> simplify(Naked), Interior, NonManifold
join = JoinCurves(Curves=edges.Naked, Preserve=False)

# ---- group: Temperatures
# Simulation Data
importepw = Ladybug_ImportEpw(epwFile=open_weather_file)  # -> readMe, latitude, location, dryBulbTemperature, dewPointTemperature, relativeHumidity, windSpeed, windDirection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; plug-in component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
python = PythonScript()  # -> out, location, temperature, Irradiation
# ---------- python: Python ----------
pass
# ---------- end python ----------
strnum = Ladybug_SeparateData(inputList=flatten(importepw.dryBulbTemperature))  # -> numbers, strings; plug-in component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
strnum_2 = Ladybug_SeparateData(inputList=flatten(importepw.directNormalRadiation))  # -> numbers, strings; plug-in component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
strnum_3 = Ladybug_SeparateData(inputList=flatten(importepw.diffuseHorizontalRadiation))  # -> numbers, strings; plug-in component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
item_2 = ListItem(List=strnum.numbers, Index=int, Wrap=True)  # -> simplify(Item)
item_3 = ListItem(List=strnum_2.numbers, Index=int, Wrap=True)  # -> simplify(Item)
item_4 = ListItem(List=strnum_3.numbers, Index=int, Wrap=True)  # -> simplify(Item)

# ----
area = Area(Geometry=join)  # -> simplify(Area), Centroid
scale = Scale(Geometry=join, Center=area.Centroid, Factor=window_wall_ratio)  # -> flatten(Geometry), Transform
srfsplit = SurfaceSplit(Surface=item, Curves=scale.Geometry)
item_5 = ListItem(List=debrep.Faces, Index=4, Wrap=True)
walls = ListItem(List=srfsplit, Index=0, Wrap=True)  # -> flatten(Item)
walls_2 = ListItem(List=srfsplit, Index=1, Wrap=True)  # -> flatten(Item)

# ---- group: Solar Gains
run_radiation = FalseStartToggle(False)
hour_to_simulate = Slider(0, range=0..138)
c_script = CSharpScript(name="hour_to_simulate", min=0, max=number_of_hours, decimals=0)  # -> out, A; inputs name: String, min: Double, max: Double, decimals: Int32
# ---------- c_script: C# ----------
    foreach (IGH_DocumentObject obj in owner.OnPingDocument().Objects )
    {
      Grasshopper.Kernel.Special.GH_NumberSlider slider = obj as Grasshopper.Kernel.Special.GH_NumberSlider;
      if (slider == null) { continue; }
      if (slider.NickName.Equals(name, StringComparison.OrdinalIgnoreCase))
      {
        double norm = slider.Slider.NormalizedValue;

        slider.Slider.Minimum = (decimal) min;
        slider.Slider.Maximum = (decimal) max;
        if (decimals <= 0)
        {
          slider.Slider.Type = Grasshopper.GUI.Base.GH_SliderAccuracy.Integer;
        }
        else
        {
          slider.Slider.Type = Grasshopper.GUI.Base.GH_SliderAccuracy.Float;
          slider.Slider.DecimalPlaces = decimals;
        }

        //Must disable events since we are modifying this thing during a solution.
        //This is actually illegal.
        slider.Slider.RaiseEvents = false;
        slider.Slider.NormalizedValue = norm;
        slider.Slider.RaiseEvents = true;
      }
    }
# ---------- c_script: C# additional code ----------
///Taken from: http://www.grasshopper3d.com/forum/topics/change-number-slider-parameter-using-python
# ---------- end c_script ----------
gencumulativeskymtx = Ladybug_GenCumulativeSkyMtx(epwFile=open_weather_file, skyDensity=0, useOldRes=True, runIt=Toggle(True))  # -> readMe, cumulativeSkyMtx; plug-in component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
fly = Ladybug_fly(inputSliders=hour_to_simulate, fly=run_radiation)  # -> Vviiiiiiiiiizzz; plug-in component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
item_6 = ListItem(List=int, Index=hour_to_simulate, Wrap=True)
selectskymtx = Ladybug_selectSkyMtx(cumulativeSkyMtx=gencumulativeskymtx.cumulativeSkyMtx, HOY=item_6, removeDiffuse=False, removeDirect=False)  # -> readMe, selectedSkyMtx; plug-in component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
toggle = BooleanToggle(True)
panel_2 = Panel(".1")
radiationanalysis = Ladybug_RadiationAnalysis(
    geometry=flatten(walls_2),
    gridSize="1",
    disFromBase=panel_2,
    selectedSkyMtx=flatten(selectskymtx.selectedSkyMtx),
    runIt=toggle)  # -> readMe, contextMesh, analysisMesh, testPts, testVec, port, radiationResult, radiationMesh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; plug-in component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
multiplication = Multiplication(A=radiationanalysis.totalRadiation, B=1000)
variable_recorder = PythonScript(x=multiplication, array_length=number_of_hours)  # -> out, recorded_result; inputs array_length: Int32
# ---------- variable_recorder: Python ----------
"""
Data recorder with variable output length.

#TODO: reset recL every time array_length is changed.
"""
if 'recL' in locals() and array_length!=None:
        recL.append(x)
else:
    recL = []

recorded_result = recL[len(recL)-array_length:]
# ---------- end variable_recorder ----------

# ----
# Export Attributes and Results
selectskymtx_2 = Ladybug_selectSkyMtx(cumulativeSkyMtx=gencumulativeskymtx.cumulativeSkyMtx, HOY=number_slider, removeDiffuse=False, removeDirect=False)  # -> readMe, selectedSkyMtx; plug-in component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
brep = Brep(walls_2)
volume = Volume(Geometry=box)  # -> Volume, Centroid
area_2 = Area(Geometry=item_5)  # -> Area, Centroid

# ---- group: Hacky grasshopper way to read schedule from csv
# Internal Gains
occupancy_schedules_csv = Panel("C:\Users\Zghiru\Documents\GitHub\RC_BuildingSimulator\rc_simulator\grasshopper_component\occupancy_schedules.csv")
file = ReadFile(File=occupancy_schedules_csv, PerLineParse=True)
list = ValueList({"Multi Residential": 0, "Single Residential": 1, "Hotel": 2, "Office": 3, "Retail": 4, "Foodstore": 5, "Restaurant": 6, "Industrial": 7, "School": 8, "Hospital": 9, "Gym": 10}, selected="Office")
split = TextSplit(Text=file, Separators=",")  # -> simplify(Result)
item_7 = ListItem(List=split, Index=list, Wrap=True)  # -> flatten(Item)
panel_3 = Panel(split)
cull_i_2 = CullIndex(List=item_7, Indices=0, Wrap=True)
item_8 = ListItem(List=cull_i_2, Index=int, Wrap=True)
python_2 = PythonScript(area=area_2.Area, max_occupancy="3", occupancy_per_m2=item_8)  # -> out, occupancy, internal_gains; inputs occupancy_per_m2: list
# ---------- python_2: Python ----------
# This doesn't make sense yet 
#The units for rate should be 
# occupancy = rate * number of occupants * area

gains_per_person = 100 #W
appliance_gains = 14  # W per sqm

occupancy = list(map(lambda x:max_occupancy*x, occupancy_per_m2))

internal_gains = list(map(lambda x: gains_per_person*x + area*appliance_gains, occupancy))
# ---------- end python_2 ----------

# ----
debrep_2 = DeconstructBrep(Brep=walls_2)  # -> Faces, Edges, Vertices
walls_3 = ListItem(List=debrep_2.Edges, Index=2, Wrap=True)  # -> flatten(Item)
Y = UnitY(Factor=1)
number_slider_2 = Slider(1.4, range=1..2)

# ----
# Create Zone
number_slider_3 = Slider(1.2, range=1..2)
glazedelement = GlazedElement(window_geometry=walls_2, u_value=number_slider_3, hoy_list=int, dni_list=item_3, dhi_list=item_4, run_solar=Toggle(True))  # -> out, glazed_elements, solar_gains, illuminance; inputs hoy_list: list, dni_list: list, dhi_list: list; plug-in component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
opaqueelement = OpaqueElement(geometry=walls, u_value=Slider(0.1, range=0..0.6))  # -> out, centers, normals, opaque_element; plug-in component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
zone2 = Zone2(
    glazed_elements=glazedelement.glazed_elements,
    opaque_elements=opaqueelement.opaque_element,
    volume=volume.Volume,
    floor_area=area_2.Area,
    ach_vent=number_slider_2,
    ach_infl=number_slider_2)  # -> readMe, Zone, unique_inputs; inputs glazed_elements: list, opaque_elements: list, thermal_bridges: list; plug-in component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

extr = Extrude(Base=walls_3, Direction=expr("-x", Y))
radiationanalysis_2 = Ladybug_RadiationAnalysis(
    geometry=flatten(walls_2),
    context=flatten(extr),
    gridSize=0.3,
    disFromBase=panel_2,
    selectedSkyMtx=flatten(selectskymtx_2.selectedSkyMtx),
    runIt=toggle)  # -> readMe, contextMesh, analysisMesh, testPts, testVec, port, radiationResult, radiationMesh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; disabled; plug-in component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

# ---- group: method 2
calc_solar_gains = PythonScript(
    window_geometry=brep,
    context_geometry=extr,
    hoy=addition_2,
    year="2005",
    ladybug_location=importepw.location,
    hoy_list=int,
    dni_list=item_3,
    dhi_list=strnum_3.numbers,
    run=Toggle(False))  # -> out, solar_gains, illuminance; inputs context_geometry: list, year: Int32, hoy_list: list, dni_list: list, dhi_list: list
# ---------- calc_solar_gains: Python ----------
import rhinoscriptsyntax as rs
import Rhino as rc
import ghpythonlib.components as gh
import math
import datetime


class RadiationWindow(object):
    """
    Adapted from RC-building simulator's Window object in radiation.py
    
    returns solar_gains, illuminance through window as a list
    """

    def __init__(self, window_geometry, context_geometry, location, year, 
                 glass_solar_transmittance=0.7, glass_light_transmittance=0.8):
        
        self.window_geometry = window_geometry
        self.context_geometry = context_geometry
        print context_geometry is None
        # initialize window centroid, vertices, normal and tilt
        self.extract_window_geometry()
        
        #TODO: make this part of location
        self.year = year 
        # Extract location data
        x_lines = [s.strip() for s in location.splitlines()]
        self.latitude_deg = float(x_lines[2].split(',')[0])
        self.longitude_deg = float(x_lines[3].split(',')[0])
        self.utc_offset = float(x_lines[4].split(',')[0])

        self.glass_solar_transmittance = glass_solar_transmittance
        self.glass_light_transmittance = glass_light_transmittance

    def extract_window_geometry(self):
        """
        This function creates the following attributes during __init__:
        self.window_centroid
        self.window_normal
        self.window_vertices
        self.altitude_tilt_rad
        self.azimuth_tilt_rad
        """
        north = rc.Geometry.Vector3d(0,1,0)
        vertical = rc.Geometry.Vector3d(0,0,1)
        faces_west = False
        self.window_centroid = rs.SurfaceAreaCentroid(self.window_geometry)[0]
        normal = rs.SurfaceNormal(self.window_geometry,[0.5,0.5])
        self.window_normal = normal
        self.window_vertices = rs.SurfaceEditPoints(window_geometry)
        
        if normal[0] < 0:
            faces_west = True
        else:
            faces_west = False
        
        normal_xy = rc.Geometry.Vector3d(normal[0],normal[1],0)
        normal_xz = rc.Geometry.Vector3d(normal[0],0,normal[2])

        
        try:
            azimuth = rs.VectorAngle(north,normal_xy)
            if faces_west:
                azimuth = 360-azimuth
        except ValueError:
            azimuth = 0
        
        try: 
            altitude = rs.VectorAngle(vertical,normal_xz)
        except ValueError:
            altitude = 0
        
        self.alititude_tilt_rad = math.radians(altitude)
        self.azimuth_tilt_rad = math.radians(azimuth)

    def calc_sun_position(self, hoy):
        """
        Credits: Prageeth Jayathissa, Joan Domènech Masferrer 
        Calculates the sun position for a specific hour of the year and location,
        according to traditional convention.
        :param latitude_deg: Local Latitude [Degrees]. North+, South-.
        :type latitude_deg: float
        :param longitude_deg: Local Longitude [Degrees]. East+, West-.
        :type longitude_deg: float
        :param year: year
        :type year: int
        :param hoy: Hour of the year from the start. The first hour of January is 1
        :type hoy: int
        :param utc_offset: Time zone offset i.r. to Prime Meridian [hours]
        :type utc_offset: int
        :return: altitude, azimuth, sunvec: Sun altitude and azimuth [Degrees] (Traditional convention) and sun vecto
        :rtype: float,float,Vector3d
        """
        # Source http://www.pveducation.org/pvcdrom/properties-of-sunlight/declination-angle
    
        # Set the date in UTC based off the hour of year and the year itself
        start_of_year = datetime.datetime(self.year, 1, 1, 0, 0, 0, 0);
        utc_datetime = start_of_year + datetime.timedelta(hours = hoy);
    
        # Determine the day of the year
        day_of_year = utc_datetime.timetuple().tm_yday;
    
        # Calculate B parameter (in radians) for equation of time
        b_factor = (day_of_year - 1) * ((2 * math.pi) / 365);
    
        # Equation of time: empirical equation that corrects for the eccentricity of 
        # the Earth's orbit and the Earth's axial tilt        
        equation_of_time = 229.2 * 0.000075 + 229.2 * (0.001868 * math.cos(b_factor) - \
                                                       0.032077 * math.sin(b_factor)) - \
                                                       229.2 * (0.014615 * math.cos(2 * b_factor) + \
                                                                0.04089 * math.sin(2 * b_factor));
    
        # Local Standart Time Meridian (Earth rotation 15 degrees/h)
        standard_time = 15 * self.utc_offset
    
        # Time correction between local standard time and true solar time (in minutes) 
        time_correction = 4 * (self.longitude_deg - standard_time) + equation_of_time 
    
        # Local Solar Time (in hours) = Local Time + TC (in hours)
        solar_time = utc_datetime.hour + (utc_datetime.minute + time_correction) / 60.0;
    
        # Translate Local Solar Time to an angle 
        hour_angle_rad = (math.pi * 2 / 24) * (solar_time - 12);
    
        # Calculate the declination angle: The variation due to the earths tilt
        declination_rad = math.radians(23.45 * math.sin((2 * math.pi / 365.0) * 
                                                        (day_of_year - 81)));
    
        # Convert latitude to to radians
        latitude_rad = math.radians(self.latitude_deg);
    
        # Altitude Position of the sun in radians
        sun_alt_rad = math.asin(math.cos(latitude_rad) * math.cos(declination_rad) * 
                                 math.cos(hour_angle_rad) +
                                 math.sin(latitude_rad) * math.sin(declination_rad));
    
        # Azimuth Position fo the sun in radians
        sun_az_rad = math.acos((math.sin(declination_rad) *
                                    math.cos(latitude_rad) - math.cos(declination_rad) *
                                    math.sin(latitude_rad) * math.cos(hour_angle_rad)) /
                                    math.cos(sun_alt_rad))
    
        # Range azimuth [0, 360) degrees
        if hour_angle_rad > 0 or hour_angle_rad < - math.pi :
            sun_az_rad = math.pi * 2 - sun_az_rad
        
        sunvec_x = -math.sin(sun_az_rad) * math.cos(sun_alt_rad);
        sunvec_y = -math.cos(sun_az_rad) * math.cos(sun_alt_rad);
        sunvec_z = -math.sin(sun_alt_rad)
        sunvec = rc.Geometry.Vector3d(sunvec_x,sunvec_y,sunvec_z)
    
        return math.degrees(sun_alt_rad), math.degrees(sun_az_rad), sunvec

    def is_sunny(self,hoy):
        """
        Checks wether is sunny or not by comparing the sun vector and window normal.
        :rtype: bool
        """

        sun_alt_deg,sun_az_deg,sunvec = self.calc_sun_position(hoy)
        
        x_win = self.window_normal[0] > 0
        x_sun = sunvec[0] > 0
        y_win = self.window_normal[1] > 0
        y_sun = sunvec[1] > 0
        
        x = (x_win and not x_sun) or (x_sun and not x_win)
        y = (y_win and not y_sun) or (y_sun and not y_win)
        z = sunvec[2] < 0
        
        return x and y and z

    def context_to_clockwise_points(self,shade):
        """
        :return sorted_points: list of points sorted clockwise
        :rtype sorted_points: list
        """
        points = rs.SurfacePoints(shade,True)
        centroid, error= rs.SurfaceAreaCentroid(shade)
        
        # Generate plane oriented to world-Z
        plane = rc.Geometry.Plane(centroid,rc.Geometry.Vector3d(0,0,-1))
        
        # calculate vectors from center to points
        vecs = [centroid - point for point in points]
        
        # calculate angles between vectors and plane x-axis
        angles = [rc.Geometry.Vector3d.VectorAngle(plane.XAxis,v,plane) for v in vecs]
        sorted_points = [p[1] for p in sorted(zip(angles,points))] 
        return sorted_points

    def point_in_window(self,point):
        x = []
        y = []
        z = []

        for v in self.window_vertices:
            x.append(v[0])
            y.append(v[1])
            z.append(v[2])
        
        x_range = min(x) <= point[0] <= max(x)
        y_range = min(y) <= point[1] <= max(y)
        z_range = min(z) <= point[2] <= max(z)
        
        return x_range and y_range and z_range

    def unshaded_window_surfaces(self, sun_vector):
        """
        returns a set of surfaces representing the unshaded parts of the window
        """
        
        # Scale window geometry so that all points hit the surface
        window_plane = rs.ScaleObject(self.window_geometry,self.window_centroid,
            (10,10,10),True)
        
        # Project shadows to window surface and merge overlapping shadows
        shadow_geometry = []
        
        print self.context_geometry is None
        for shade in self.context_geometry:
            # Arrange shade vertices clockwise
            shade_points = shade_to_clockwise_points(shade)
    
            # Draw Shadow
            shadow_points = rs.ProjectPointToSurface(shade_points,window_plane,sun_vector)
            if shadow_points is not None:
                shadow = rs.AddSrfPt(shadow_points)
                if shadow is None:
                    shadow = gh.SurfaceFromPoints(shadow_points)
    
            # First shadow
            if shadow_geometry == []:
                shadow_geometry = [shadow]
                
            # Subsequent shadows
            else:
                for existing_shadow in shadow_geometry:
                    # try boolean union
                    union = rs.BooleanUnion(existing_shadow,shadow)
                    
                    if union is not None:
                        # current shadow successfully merged with existing shadow
                        existing_shadow = union
                        
                    else:
                        # No intersection. current shadow is isolated
                        shadow_geometry.append(shadow)
    
        # sequentially subtract each shadow from the window geometry.
        if self.window_geometry is not None and shadow_geometry != []:
    
            # Initialise unshaded fragments
            unshaded_fragments = [self.window_geometry]
            
            for shadow in shadow_geometry:
                for ff in range(0,len(unshaded_fragments)):
                    intersection = rs.BooleanIntersection(unshaded_fragments[ff], shadow, False)
                    
                    # Discard intersections outside window geometry
                    new_fragments = []
                    for i in intersection:
                        intersection_centroid = rs.SurfaceAreaCentroid(i)[0]
                        if self.point_in_window(intersection_centroid):
                            new_fragments.append(i)
                    
                    # replace existing fragment with newly created fragments
                    unshaded_fragments[ff] = new_fragments
    
                # Flatten new list of fragments for the next shadow iteration
                if any(type(f) is list for f in unshaded_fragments):
                    unshaded_fragments = [item for sublist in unshaded_fragments for item in sublist]
            
            return unshaded_fragments
        else:
            return None

    def calc_unshaded_area(self,sun_vector):
        unshaded_fragments = self.unshaded_window_surfaces(sun_vector)
        if unshaded_fragments is not None:
            fragment_areas = [rs.SurfaceArea(f)[0] for f in unshaded_fragments]
            unshaded_area = sum(fragment_areas)
            percent_shaded = unshaded_area / rs.SurfaceArea(self.window_geometry)[0] * 100
            return unshaded_area, percent_shaded
        else:
            return 0, 100

    def calc_solar_gains(self, hoy, direct_normal_irradiation, diffuse_horizontal_irradiation):
        """
        Calculates the Solar Gains in the building zone through the set Window

        :param sun_altitude: Altitude Angle of the Sun in Degrees
        :type sun_altitude: float
        :param sun_azimuth: Azimuth angle of the sun in degrees
        :type sun_azimuth: float
        :param direct_normal_irradiation: Normal Direct Radiation from weather file
        :type direct_normal_irradiation: float
        :param diffuse_horizontal_irradiation: Horizontal Diffuse Radiation from weather file
        :type diffuse_horizontal_irradiation: float
        :return: self.incident_solar, Incident Solar Radiation on window
        :return: self.solar_gains - Solar gains in building after transmitting through the window
        :rtype: float
        """

        sun_altitude,sun_azimuth,sun_vector = self.calc_sun_position(hoy)
        
        direct_factor = self.calc_direct_solar_factor(sun_altitude, sun_azimuth)
        diffuse_factor = self.calc_diffuse_solar_factor()

        direct_solar = direct_factor * direct_normal_irradiation
        diffuse_solar = diffuse_horizontal_irradiation * diffuse_factor
        
        unshaded_area, percent_unshaded = self.calc_unshaded_area(sun_vector)
        
        incident_solar = (direct_solar + diffuse_solar) * unshaded_area
        
        solar_gains = incident_solar * self.glass_solar_transmittance
        
        return solar_gains

    def calc_illuminance(self, hoy, direct_normal_illuminance, diffuse_horizontal_illuminance):
        """
        Calculates the Illuminance in the building zone through the set Window

        :param sun_altitude: Altitude Angle of the Sun in Degrees
        :type sun_altitude: float
        :param sun_azimuth: Azimuth angle of the sun in degrees
        :type sun_azimuth: float
        :param direct_normal_illuminance: Normal Direct Illuminance from weather file [Lx]
        :type direct_normal_illuminance: float
        :param diffuse_horizontal_illuminance: Horizontal Diffuse Illuminance from weather file [Lx]
        :type diffuse_horizontal_illuminance: float
        :return: self.incident_illuminance, Incident Illuminance on window [Lumens]
        :return: self.transmitted_illuminance - Illuminance in building after transmitting through the window [Lumens]
        :rtype: float
        """

        sun_altitude,sun_azimuth,sun_vector = self.calc_sun_position(hoy)
        
        direct_factor = self.calc_direct_solar_factor(sun_altitude, sun_azimuth,)
        diffuse_factor = self.calc_diffuse_solar_factor()

        direct_illuminance = direct_factor * direct_normal_illuminance
        diffuse_illuminance = diffuse_factor * diffuse_horizontal_illuminance

        unshaded_area, percent_unshaded = self.calc_unshaded_area(sun_vector)
        
        incident_illuminance = (
            direct_illuminance + diffuse_illuminance) * unshaded_area
        transmitted_illuminance = incident_illuminance * \
            self.glass_light_transmittance
        
        return transmitted_illuminance

    def calc_direct_solar_factor(self, sun_altitude, sun_azimuth):
        """
        Calculates the cosine of the angle of incidence on the window 
        """
        sun_altitude_rad = math.radians(sun_altitude)
        sun_azimuth_rad = math.radians(sun_azimuth)

        # If the sun is in front of the window surface
        if math.cos(sun_azimuth_rad - self.azimuth_tilt_rad) > 0:
            # Proportion of the radiation incident on the window (cos of the
            # incident ray)
            direct_factor = math.cos(sun_altitude_rad) * math.cos(sun_azimuth_rad - self.azimuth_tilt_rad) + \
                math.sin(sun_altitude_rad) * math.cos(self.alititude_tilt_rad)

        else:
            # If sun is behind the window surface
            direct_factor = 0

        return direct_factor

    def calc_diffuse_solar_factor(self):
        """Calculates the proportion of diffuse radiation"""
        # Proportion of incident light on the window surface
        return (1 + math.cos(self.alititude_tilt_rad)) / 2


# initialize window
Window = RadiationWindow(window_geometry=window_geometry, 
                         context_geometry=context_geometry, 
                         location=ladybug_location,
                         year=year)

solar_gains = []
illuminance = []

if run:
    for ii in range(0,len(hoy_list)):
        hoy = hoy_list[ii]
        dni = dni_list[ii]
        dhi = dhi_list[ii]
        
        if Window.is_sunny(hoy):
            solar_gains.append(Window.calc_solar_gains(hoy,dni,dhi))
            illuminance.append(Window.calc_illuminance(hoy,dni,dhi))
        else:
            solar_gains.append(0)
            illuminance.append(0)
# ---------- end calc_solar_gains ----------

# ----
panel_4 = Panel(calc_solar_gains.solar_gains)
panel_5 = Panel(calc_solar_gains.illuminance)
panel_6 = Panel("47.377")
panel_7 = Panel("8.549")
panel_8 = Panel(strnum_2.numbers)
# Lighting data
title = Panel("indoor_air_temperature")
title_2 = Panel("outdoor_air_temperature")
title_3 = Panel("occupancy")
title_4 = Panel("ill")
# Energy data
title_5 = Panel("HOY")
title_6 = Panel("solar_gains")
title_7 = Panel("heating_demand")
title_8 = Panel("cooling_demand")
title_9 = Panel("lighting_demand")
# Temperature data
title_10 = Panel("HOY")
title_11 = Panel("internal_gains")
ins = InsertItems(List=int, Item=title_5, Indices=0, Wrap=True)  # -> graft(List)
ins_2 = InsertItems(List=python_2.internal_gains, Item=title_11, Indices=0, Wrap=True)  # -> graft(List)
ins_3 = InsertItems(List=int, Item=title_10, Indices=0, Wrap=True)  # -> graft(List)
ins_4 = InsertItems(List=item_2, Item=title_2, Indices=0, Wrap=True)  # -> graft(List)
ins_5 = InsertItems(List=int, Item=title_10, Indices=0, Wrap=True)  # -> graft(List)
ins_6 = InsertItems(List=python_2.occupancy, Item=title_3, Indices=0, Wrap=True)  # -> graft(List)
panel_9 = Panel("C:\Users\Zghiru\Documents\GitHub\RC_BuildingSimulator\rc_simulator\grasshopper_component\tests\grasshopper_result_energy.csv")  # disabled
panel_10 = Panel("C:\Users\Zghiru\Documents\GitHub\RC_BuildingSimulator\rc_simulator\grasshopper_component\tests\grasshopper_result_temperatures.csv")  # disabled

radiation = Panel("hoy")
radiation_2 = Panel("radiation")
radiation_3 = Panel("internal_gains")
day_month_hour_calculator = Ladybug_Day_Month_Hour(HOY=int)  # -> day, month, hour, date; plug-in component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
ins_7 = InsertItems(List=variable_recorder.recorded_result, Item=radiation_2, Indices=0, Wrap=True)  # -> graft(List)
ins_8 = InsertItems(List=python_2.internal_gains, Item=radiation_3, Indices=0, Wrap=True)  # -> graft(List)
ins_9 = InsertItems(List=day_month_hour_calculator.date, Item=radiation, Indices=0, Wrap=True)  # -> graft(List)
merge = Merge(Data1=simplify(ins_9), Data2=simplify(ins_7), Data3=simplify(ins_8))
join_2 = TextJoin(Text=merge, Join=",")  # -> flatten(Result)
inputs = Panel(join_2)

panel_11 = Panel("C:\Users\Zghiru\Documents\GitHub\RC_BuildingSimulator\rc_simulator\grasshopper_component\tests\grasshopper_result_lighting.csv")  # disabled

# ----
# Unit Tests (just like python version)
panel_12 = Panel("test")
test = Slider(0, range=0..1)
unit_test_master = UnitTestMaster(run=test)  # -> out, number_of_tests, Zone, port, outdoor_air_temperature, previous_mass_temperature, internal_gains, solar_gains, illuminance, occupancy; inputs run: Int32; plug-in component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
c_script_2 = CSharpScript(name=panel_12, min=0, max=unit_test_master.number_of_tests, decimals=0)  # -> out, A; inputs name: String, min: Double, max: Double, decimals: Int32; same code as c_script
simulateonetimestep = SimulateASingleTimeStep(
    Zone=unit_test_master.Zone,
    outdoor_air_temperature=unit_test_master.outdoor_air_temperature,
    previous_mass_temperature=unit_test_master.previous_mass_temperature,
    internal_gains=unit_test_master.internal_gains,
    solar_gains=unit_test_master.solar_gains,
    illuminance=unit_test_master.illuminance,
    occupancy=unit_test_master.occupancy)  # -> readMe, indoor_air_temperature, mass_temperature, lighting_demand, heating_demand, heating_sys_electricity, cooling_demand, cooling_sys_electricity, energy_demand, cop; plug-in component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
unit_test_slave = UnitTestSlave(
    mass_temperature=simulateonetimestep.mass_temperature,
    lighting_demand=simulateonetimestep.lighting_demand,
    heating_sys_electricity=simulateonetimestep.heating_sys_electricity,
    cooling_sys_electricity=simulateonetimestep.cooling_sys_electricity,
    energy_demand=simulateonetimestep.energy_demand,
    cop=simulateonetimestep.cop,
    run=test)  # -> out, test_passed; inputs run: Int32; plug-in component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
c_script_3 = CSharpScript(toggle=unit_test_slave.test_passed)  # -> out, A; inputs toggle: Boolean
# ---------- c_script_3: C# ----------
    Color ok = Color.Green;
    Color notOk = Color.Red;

    List<Grasshopper.Kernel.Special.GH_Group> groups = GrasshopperDocument
      .Objects
      .OfType<Grasshopper.Kernel.Special.GH_Group>()
      .Where(gr => gr.ObjectIDs.Contains(Component.InstanceGuid))
      .ToList<Grasshopper.Kernel.Special.GH_Group>();

    Color renderColor = ok;
    if (!toggle)
    {
      renderColor = notOk;
    }

    foreach (Grasshopper.Kernel.Special.GH_Group gr in groups)
    {
      gr.Colour = renderColor;
    }
# ---------- end c_script_3 ----------
panel_13 = Panel(unit_test_slave.out)

# ---- group: simulate period
# Simulate Period
simulatemultipletimesteps = SimulateMultipleTimeSteps(
    Zone=zone2.Zone,
    outdoor_air_temperature=item_2,
    internal_gains=python_2.internal_gains,
    solar_irradiation=glazedelement.solar_gains,
    occupancy=python_2.occupancy,
    illuminance=glazedelement.illuminance)  # -> out, indoor_air_temperature, mass_temperature, lighting_demand, heating_demand, cooling_demand, energy_demand, solar_gains, ill; inputs outdoor_air_temperature: list, previous_mass_temperature: list, internal_gains: list, solar_irradiation: list, occupancy: list; plug-in component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
panel_14 = Panel(simulatemultipletimesteps.out)
outdoor_temperature = Panel(item_2)
cooling_demand_w = Panel(simulatemultipletimesteps.cooling_demand)
heating_demand_w = Panel(simulatemultipletimesteps.heating_demand)
indoor_temperature = Panel(simulatemultipletimesteps.indoor_air_temperature)
lighting_demand_w = Panel(simulatemultipletimesteps.lighting_demand)
mass_temperature = Panel(simulatemultipletimesteps.mass_temperature)

# ----
ins_10 = InsertItems(List=simulatemultipletimesteps.cooling_demand, Item=title_8, Indices=0, Wrap=True)  # -> graft(List)
ins_11 = InsertItems(List=simulatemultipletimesteps.heating_demand, Item=title_7, Indices=0, Wrap=True)  # -> graft(List)
ins_12 = InsertItems(List=simulatemultipletimesteps.lighting_demand, Item=title_9, Indices=0, Wrap=True)  # -> graft(List)
ins_13 = InsertItems(List=simulatemultipletimesteps.solar_gains, Item=title_6, Indices=0, Wrap=True)  # -> graft(List)
ins_14 = InsertItems(List=simulatemultipletimesteps.indoor_air_temperature, Item=title, Indices=0, Wrap=True)  # -> graft(List)
ins_15 = InsertItems(List=simulatemultipletimesteps.ill, Item=title_4, Indices=0, Wrap=True)  # -> graft(List)
merge_2 = Merge(
    Data1=simplify(ins),
    Data2=simplify(ins_13),
    Data3=simplify(ins_11),
    Data4=simplify(ins_10),
    Data5=simplify(ins_12),
    Data6=simplify(ins_2))  # disabled
merge_3 = Merge(Data1=simplify(ins_3), Data2=simplify(ins_4), Data3=simplify(ins_14))  # disabled
merge_4 = Merge(Data1=simplify(ins_5), Data2=simplify(ins_15), Data3=simplify(ins_6))  # disabled
join_3 = TextJoin(Text=merge_2, Join=",")  # -> flatten(Result); disabled
join_4 = TextJoin(Text=merge_3, Join=",")  # -> flatten(Result); disabled
join_5 = TextJoin(Text=merge_4, Join=",")  # -> flatten(Result); disabled
toggle_2 = BooleanToggle(False)
python_3 = PythonScript(results=join_3, fileAddress=panel_9, export=toggle_2)  # -> out, a; inputs results: list; disabled
# ---------- python_3: Python ----------
import Rhino as rc

if export:
    fileName = open(fileAddress,'w')
    for line in results:
        fileName.write(line + '\n')
    fileName.close()
# ---------- end python_3 ----------
python_4 = PythonScript(results=join_4, fileAddress=panel_10, export=toggle_2)  # -> out, a; inputs results: list; disabled; same code as python_3
python_5 = PythonScript(results=join_5, fileAddress=panel_11, export=toggle_2)  # -> out, a; inputs results: list; disabled; same code as python_3
merge_5 = Merge(
    Data1=simplify(ins),
    Data2=simplify(ins_13),
    Data3=simplify(ins_11),
    Data4=simplify(ins_10),
    Data5=simplify(ins_12),
    Data6=simplify(ins_2),
    Data7=simplify(ins_3),
    Data8=simplify(ins_4),
    Data9=simplify(ins_14),
    Data10=simplify(ins_5),
    Data11=simplify(ins_15),
    Data12=simplify(ins_6))
panel_15 = Panel("C:\Users\Zghiru\Documents\GitHub\RC_BuildingSimulator\rc_simulator\grasshopper_component\tests\grasshopper_attributes.csv")
panel_16 = Panel("C:\Users\Zghiru\Documents\GitHub\RC_BuildingSimulator\rc_simulator\grasshopper_component\tests\grasshopper_result.csv")

# ---- group: DNI
strnum_4 = Ladybug_SeparateData(inputList=flatten(importepw.directNormalRadiation))  # -> numbers, strings; plug-in component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
item_9 = ListItem(List=strnum_4.numbers, Index=int, Wrap=True)  # -> simplify(Item)

# ----
join_6 = TextJoin(Text=merge_5, Join=",")  # -> flatten(Result)
python_6 = PythonScript(fileAddress=panel_15, export=toggle_2)  # -> out, a; inputs results: list
# ---------- python_6: Python ----------
import Rhino as rc

if export:
    fileName = open(fileAddress,'w+')
    for line in results:
        fileName.write(line + '\n')
    fileName.close()
# ---------- end python_6 ----------
python_7 = PythonScript(results=join_6, fileAddress=panel_16, export=toggle_2)  # -> out, a; inputs results: list; same code as python_6
energy = QuickGraph(item_9)

# ----
# y-axis ticks (in progress)
energy_2 = QuickGraph([simulatemultipletimesteps.solar_gains, python_2.internal_gains, lighting_demand_w, heating_demand_w, cooling_demand_w])
occupancy = QuickGraph(python_2.occupancy)
eval = Evaluate(F="(y-x)/z+1", x="0", y="30", z="5")
graph_gridlines = PythonScript(start="0", end="30", y_interval="5", x_length=number_of_hours)  # -> out, a; inputs x_length: Int32
# ---------- graph_gridlines: Python ----------
"""
This funtion creates a series of lists which can be used 

list_to_tree was taken from https://gist.github.com/piac/ef91ac83cb5ee92a1294
"""
domain = end - start

def list_to_tree(input, none_and_holes=True, source=[0]):
    """Transforms nestings of lists or tuples to a Grasshopper DataTree"""
    from Grasshopper import DataTree as Tree
    from Grasshopper.Kernel.Data import GH_Path as Path
    from System import Array
    def proc(input,tree,track):
        path = Path(Array[int](track))
        if len(input) == 0 and none_and_holes: tree.EnsurePath(path); return
        for i,item in enumerate(input):
            if hasattr(item, '__iter__'): #if list or tuple
                track.append(i); proc(item,tree,track); track.pop()
            else:
                if none_and_holes: tree.Insert(item,path,i)
                elif item is not None: tree.Add(item,path)
#if input is not None: t=Tree[object]();proc(input,t,source[:]);return t

# create a list of the desired ticks
y_ticks = []
number_of_ticks = int(domain//y_interval)
for ii in range(0,number_of_ticks):
    y_ticks.append(start+ii*y_interval)

# create a list of lists, with each sublist having length x_length
tick_list = []
for tick in y_ticks:
    tick_list.append([tick]*x_length)

a = list_to_tree(tick_list,True,[0])
# ---------- end graph_gridlines ----------
series_2 = Series(Start="0", Step="5", Count=eval)
dup = DuplicateData(Data=graft(series_2), Number=number_of_hours, Order=True)
panel_17 = Panel(graph_gridlines.out)

# ---- group: Temperature
graph = QuickGraph([outdoor_temperature, indoor_temperature, mass_temperature, dup])

# ----
number_slider_4 = Slider(19, range=-15..30)

panel_18 = Panel("C:\Users\Zghiru\Documents\GitHub\RC_BuildingSimulator\rc_simulator\grasshopper_component")  # disabled
toggle_3 = BooleanToggle(False)  # disabled
exportladybug = Ladybug_ExportLadybug(components=emissionsystems, targetFolder=panel_18, export=toggle_3)  # -> readMe; disabled; plug-in component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
panel_19 = Panel(exportladybug)  # disabled

number_slider_5 = Slider(20, range=-15..30)
number_slider_6 = Slider(0.1, range=0..1)
number_slider_7 = Slider(95, range=0..2000)
number_slider_8 = Slider(2000, range=0..2000)

# ==== cluster Cluster
L = ClusterInput()
lng = ListLength(List=L)
G = ClusterInput()
series = Series(Start=0, Step=1, Count=lng)
area = Area(Geometry=G)  # -> Area, Centroid
int = Integer(series)
orient2camera = Ladybug_OrientToCamera(initPosition=area.Centroid)  # -> orientedToCam; plug-in component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
int_2 = ClusterOutput(int)
timer = Timer(TimerInterval=1000, Target=orient2camera)
orientedtocam = ClusterOutput(orient2camera)
